test file "AccelPdl"

suite "New Test Suite 1"

  case "AP1-1_ArbitratedPdlPos0" [baseline]
    model AccelPdl, mode Normal
    input "ModelInputs.mat", mapped to Accelerator Pedal Position Primary, Accelerator Pedal Position Secondary, Brake Pedal Position, EDU Fault, Gear Selector (active)
    assessment "Silmutaneous Input Logic": At any point of time, whenever AccelPedalPos > 0.5 & BrakePedalPos > 0.5 is true then, with no delay, SilmInputStatus == logical(1) must be true
    assessment "Test Arbitrated Position = 0": At any point of time, whenever SilmInputStatus == logical(1) | EDUfault == logical(1) | AccelPdl_Fault == logical(1) is true then, with no delay, ArbitPedalPos == 0 must be true
      AccelPedalPos: signal AccelPdl/Accelerator Pedal Position Primary, port 1
      BrakePedalPos: signal AccelPdl/Brake Pedal Position, port 1
      SilmInputStatus: signal AccelPdl/Simultanious Input Check/AND, port 1
      EDUfault: signal AccelPdl/EDU Fault, port 1
      AccelPdl_Fault: signal AccelPdl/From, port 1
      ArbitPedalPos: signal AccelPdl/Arbitrated Pedal Value Determination/Switch, port 1