# Requirement set Accel_Pdl (R2023a)
Requirements Testing Round

## 1 [AP 1] If any of the following situations occur, the arbitrated pedal position must be 0.
1. If any of the following situations occur, the arbitrated pedal position must be 0.
- Simultaneous Input of Brake Pedal and Accelerator Pedal Primary is detected
- EDU fault is present
- Accelerator fault is present