# Requirement set IndicatorBoard (R2023a)

## 1 [IB 1] Propulsion System light ON when enabled and not fault
Propulsion system light should be illuminated when any drive mode is enabled and will respond to control inputs. Full torque available. E.g. The driver shifts from parking to drive

## 2 [IB 2] Propulsion System Status Light OFF
OFF when the vehicle is unable to respond to control inputs.
(

## 3 [IB 3] Propulsion System Flashing when there is a fault
Flashing when faults are present that prevents the use of the propulsions system.

## 4 [IB 4] HV System Status Light ON when battery contractor closed and no Isolation Faults
Illuminated when the Energy storage system contactors are closed and Energy storage system is able to provide current to a drive system, without fault, or facilitate on-plug charging. (This includes off and charging conditions)

## 5 [IB 5] HV System Status Light OFF when battery contractor closed and no Isolation Faults
HV System Status Light OFF when Energy storage system Contactors are open and no Isolation Faults

## 6 [IB 6] HV System Status Light flashing when Isolation Faults
Ground Fault Indicator: Illuminated within 60s of when the vehicle ground fault monitor detects a ground fault.

## 7 [IB 7] The CAV Longitudinal Status light is ON when operator has turned the switch on and the CAV supervisory controller is enabled
IB 1: The CAV Longitudinal Control Status light shall be ON when longitudinal control features are allowed and the operator is able to initiate features using other buttons in the vehicle while the longitudinal control system is physically connected to and able to communicate with the CAV supervisory controller.

## 8 [IB 8] The CAV Longitudinal status is OFF
OFF when the “CAV Longitudinal Control” switch is in the off position.

## 9 [IB 9] The CAV Longitudinal Light Flashing
Flashing when faults are present that prevents the use of any longitudinal control feature.

## 10 [IB 10] The CAV Lateral Control Status ON
Illuminated when the lateral CAV system is physically connected to and able to communicate with the CSC, i.e. (Lat. control system is enabled and ready to provide the features.). Must be illuminated to initialize any lateral control features.

## 11 [IB 11] The CAV Lateral Control Status OFF
OFF when the “CAV Lateral Control” switch is in the off position.

## 12 [IB 12] The CAV Lateral Control Status FLASHING